# Dynamo graph Export_Image.dyn (Dynamo 1.3.4.6666)

views = Views("Level 1")
views_2 = Views("Level 2")
create = List.Create(views, views_2)
exportImage = Custom[ExportImage](ViewToExport=create)  # Views export as images with the default settings.
