# Dynamo graph WP_FillRegions.dyn (Dynamo 1.3.2.2480)

# group: COLLECT ROOM
categories = Categories("Rooms")
getLinkDocument = Custom[GetLinkDocument]()  # Get all link document. Each list contains , [0] Name of Link Document (String) [1] Link Document (Document)
code_block = CodeBlock(i=getLinkDocument) { i[42][1]; }
getElementFromLinkDocument = Quasar.LinkDocumentUtility.GetElementFromLinkDocument(categories, code_block)

# group: FLOOR TYPE FILL REGION
views = Views("12TH STOREY")
code_block_2 = CodeBlock { "WP TYPE FLOOR"; "TYPE 4"; }
getParameterValueByName = Element.GetParameterValueByName(element=getElementFromLinkDocument, parameterName=code_block_2.out0)
eq = getParameterValueByName == code_block_2.out1
filterByBoolMask = List.FilterByBoolMask(list=getElementFromLinkDocument, mask=eq)
code_block_3 = CodeBlock { "Number"; }
getParameterValueByName_2 = Element.GetParameterValueByName(parameterName=code_block_3)  # unwired: element
sortByFunction = SortByFunction(filterByBoolMask.in, getParameterValueByName_2)
coreBoundary = Room.CoreBoundary(sortByFunction)
select_filled_region_type = FilledRegionTypes("TYPE-4")
byCurves = FilledRegion.ByCurves(views, coreBoundary, select_filled_region_type)  # frozen
