# Dynamo graph print_mgr_setting.dyn (Dynamo 1.3.3.4651)

views = Views("What's New in Templates and Content")
file_path = Filename(".\efg.pdf")
string = StringInput("bbb")
print_parameters = Python(IN[0]=views, IN[1]=file_path, IN[2]=string)
# ---------- print_parameters.python (89 lines) ----------
import clr
clr.AddReference("RevitAPI")
clr.AddReference("RevitServices")

from Autodesk.Revit.DB import *
from RevitServices.Persistence import DocumentManager
from RevitServices.Transactions import TransactionManager

doc = DocumentManager.Instance.CurrentDBDocument

sheet = UnwrapElement(IN[0])

pmgr = doc.PrintManager
res = []


# set in session
pmgr.PrintSetup.CurrentPrintSetting = pmgr.PrintSetup.InSession


# determine print range
pmgr.PrintRange = PrintRange.Select
# set printer
pmgr.SelectNewPrintDriver("PDF reDirect v2")
pmgr.PrintToFile = True
pmgr.PrintToFileName = IN[1]

currentPrintSetting = pmgr.PrintSetup.CurrentPrintSetting
settingParams = currentPrintSetting.PrintParameters


# color depth type enum
settingParams.ColorDepth = ColorDepthType.Color

# hidden line views type
settingParams.HiddenLineViews = HiddenLineViewsType.RasterProcessing

# hide crop boundaries
settingParams.HideCropBoundaries = False

# hide ref/work planes
settingParams.HideReforWorkPlanes = True

# hide scope boxes
settingParams.HideScopeBoxes = True

# hide unreferenced view tags
settingParams.HideUnreferencedViewTags = False

# paper placement
settingParams.PaperPlacement = PaperPlacementType.Margins

# margin type
settingParams.MarginType = MarginType.PrinterLimit

# mask coincident lines
settingParams.MaskCoincidentLines = False

# page orientation
settingParams.PageOrientation = PageOrientationType.Landscape

# paper size
A1 = [i for i in pmgr.PaperSizes if i.Name =="A1"][0]
settingParams.PaperSize = A1

# raseter quality type
settingParams.RasterQuality = RasterQualityType.Presentation

# replace halftone 
settingParams.ReplaceHalftoneWithThinLines = False

# zoom
settingParams.ZoomType = ZoomType.Zoom
settingParams.Zoom = 100

TransactionManager.Instance.EnsureInTransaction(doc)

pmgr.PrintSetup.CurrentPrintSetting = currentPrintSetting

pmgr.PrintSetup.SaveAs(IN[2])


TransactionManager.Instance.TransactionTaskDone()
pmgr.Apply()

# sheet
pmgr.SubmitPrint(sheet)

OUT = pmgr
# ----------------------------------------
python_script = Python(IN[0]=print_parameters)  # frozen
# ---------- python_script.python (27 lines) ----------
import clr
clr.AddReference("RevitAPI")
clr.AddReference("RevitServices")

from Autodesk.Revit.DB import *
from RevitServices.Persistence import DocumentManager
from RevitServices.Transactions import TransactionManager

doc = DocumentManager.Instance.CurrentDBDocument

#TransactionManager.Instance.EnsureInTransaction()

pmgr = UnwrapElement(IN[0])
res = []

currentPrintSetting = pmgr.PrintSetup.CurrentPrintSetting
settingParams = currentPrintSetting.PrintParameters


for i in settingParams:
	if not i.startswith("__"):
		try:
			res.append([i, getattr(settingParams,i)])
		except:
			res.append(i + " can't get value.")

OUT = res
# ----------------------------------------
python_script_2 = Python(IN[0]=print_parameters)  # frozen; same code as python_script
