# Dynamo graph sheet.dyn (Dynamo 1.3.4.6666)

levels = Levels("Level 1")
categories = Categories("Rooms")
all_elements_of_category = ElementsOfCategory(categories)
name = Room.Name(all_elements_of_category)
floorPlanViewByRoom = Quasar.ViewUtility.FloorPlanViewByRoom(levels, all_elements_of_category, name)  # frozen
ceilingViewByRoom = Quasar.ViewUtility.CeilingViewByRoom(levels, all_elements_of_category, name)  # frozen
family_types = FamilyTypes("A1 metric:A1 metric")
views = Views("Room 1")
views_2 = Views("Room 2")
views_3 = Views("Room 3")
views_4 = Views("Room 4")
create = List.Create(views, views_2, views_3, views_4)
python_script = Python(IN[0]=family_types, IN[1]=create)
# ---------- python_script.python (32 lines) ----------
import clr
clr.AddReference('RevitAPI')
clr.AddReference("RevitServices")
clr.AddReference("RevitNodes")
import RevitServices
import Revit
import Autodesk
from Autodesk.Revit.DB import *

from RevitServices.Persistence import DocumentManager
from RevitServices.Transactions import TransactionManager

doc = DocumentManager.Instance.CurrentDBDocument
t = UnwrapElement(IN[0])
views = UnwrapElement(IN[1])

TransactionManager.Instance.EnsureInTransaction(doc)

sheet = ViewSheet.Create(doc, t.Id)

o = sheet.Outline
uv1 = XYZ((o.Max.U-o.Min.U)/4, (o.Max.V - o.Min.V)/1.5,0)
uv2 = XYZ((o.Max.U-o.Min.U)/1.5, (o.Max.V - o.Min.V)/1.5,0)
uv3 = XYZ((o.Max.U-o.Min.U)/4, (o.Max.V - o.Min.V)/4,0)
uv4 = XYZ((o.Max.U-o.Min.U)/1.5, (o.Max.V - o.Min.V)/4,0)

for v,loc in zip(views,[uv1,uv2,uv3,uv4]):
	Viewport.Create(doc, sheet.Id , v.Id,loc)

TransactionManager.Instance.TransactionTaskDone()	

OUT = sheet
# ----------------------------------------
