# Dynamo graph create-wallsweep.dyn (Dynamo 1.3.2.2480)

select_model_element = DSModelElementSelection()
type = archilab.Revit.Elements.Elements.Type(select_model_element)
select_model_elements = DSModelElementsSelection()  # 2 picked in the model
code_block = CodeBlock { "Reveal"; }
code_block_2 = CodeBlock { false; }
code_block_3 = CodeBlock { 1000; }
createWallSweep = Quasar.RevitNodes.CreateWallSweep(select_model_elements, arg2=code_block, arg3=code_block_2, arg4=code_block_3)  # frozen; unwired: arg1
