# Dynamo graph polygons-by-curves.dyn (Dynamo 1.3.2.2480)

code_block = CodeBlock { 0..10..5; }
byCoordinates = Point.ByCoordinates(x=code_block, y=code_block)
code_block_2 = CodeBlock { 3; }
byCenterPointRadius = Circle.ByCenterPointRadius(centerPoint=byCoordinates, radius=code_block_2)
code_block_3 = CodeBlock { {8,6,7}; }
polygonsByCurves = Custom[PolygonsByCurves](Curve=byCenterPointRadius, NumberOfSide=code_block_3)  # Create polygon by curve and number of side, returns value [ polygon, [line-segments] ]
