# Dynamo graph GetDetailGroups.dyn (Dynamo 1.3.2.2480)

python_script = Python()  # unwired: IN[0]
# ---------- python_script.python (18 lines) ----------
import clr
clr.AddReference('RevitAPI')
clr.AddReference("RevitServices")
import System
from Autodesk.Revit.DB import *
from RevitServices.Persistence import DocumentManager
from RevitServices.Transactions import TransactionManager

# get current document 
doc = DocumentManager.Instance.CurrentDBDocument



# collect detail groups
elements = FilteredElementCollector(doc).OfCategory(BuiltInCategory.OST_IOSDetailGroups).ToElements()

# output result
OUT = elements
# ----------------------------------------
