# Dynamo graph center-room.dyn (Dynamo 1.3.2.2480)

categories = Categories("Rooms")
all_elements_of_category = ElementsOfCategory(categories)
python_script = Python(IN[0]=all_elements_of_category)
# ---------- python_script.python (42 lines) ----------
import clr
clr.AddReference('ProtoGeometry')
clr.AddReference('RevitAPI')
clr.AddReference('RevitServices')
clr.AddReference("RevitNodes")

import System,Revit
clr.ImportExtensions(Revit.Elements)
clr.ImportExtensions(Revit.GeometryConversion)
from Autodesk.DesignScript.Geometry import (Geometry,
Point as pt)
from Autodesk.Revit.DB import *
from RevitServices.Persistence import DocumentManager
from RevitServices.Transactions import TransactionManager

doc = DocumentManager.Instance.CurrentDBDocument

elems = IN[0];

if not isinstance(elems,list):
	elems = UnwrapElement([elem])
else:
	elems = UnwrapElement(elems)

res = []

#TransactionManager.Instance.EnsureInTransaction(doc)

for e in elems:
	elevation = e.Level.Elevation * 304.8
	geoelem = e.GetGeometryObjectFromReference(Reference(e))
	geoobj = geoelem.GetEnumerator();
	for obj in geoobj:
		room_geometry = obj.ToProtoType()
		point = room_geometry.Centroid()
		newloc = pt.ByCoordinates(point.X,point.Y,elevation)
		#e.Location.Move(newloc.ToRevitType())
		res.append([point,newloc,newloc.ToRevitType()])

#TransactionManager.Instance.TransactionTaskDone()

OUT = res
# ----------------------------------------
