# Dynamo graph delete-parameters.dyn (Dynamo 1.3.2.2480)

python_script = Python()  # frozen; unwired: IN[0]
# ---------- python_script.python (40 lines) ----------
import clr

clr.AddReference('RevitAPI')
clr.AddReference("RevitServices")

from Autodesk.Revit.DB import *
from Autodesk.Revit.DB.Structure import *

from RevitServices.Persistence import DocumentManager
from RevitServices.Transactions import TransactionManager

doc = DocumentManager.Instance.CurrentDBDocument

elements = IN[0]
todelete = []

if not isinstance(elements, list):
	elements = [elements]
"""
class_filter = ElementClassFilter(SharedParameterElement,True)

parameters = FilteredElementCollector(doc).OfClass(ParameterElement).WherePasses(class_filter).ToElements()
"""

parameters = FilteredElementCollector(doc).OfClass(ParameterElement).ToElements()

for elem in elements:
	for param in parameters:
		if param.Name == elem:
			todelete.append(param.Id)

TransactionManager.Instance.EnsureInTransaction(doc)

res = [doc.Delete(i) for i in todelete]
				

TransactionManager.Instance.TransactionTaskDone()


OUT = res
# ----------------------------------------
removeProjectParameters = Custom[RemoveProjectParameters]()  # Remove a single or a list of project parameter by a parameter name or a list of parameters names.; unwired: ParameterName
