# Dynamo graph grid_rename.dyn (Dynamo 1.3.2.2480)

string = StringInput("Y")
string_2 = StringInput("22")
boolean = BoolSelector(false)
gridNamingGenerator = Custom[GridNamingGenerator](direction=string, startfrom=string_2, reverse=boolean)  # Generate horizontal(X) or vertical(Y) grids naming by providing startfrom(string) value and reverse (boolean) value.
