# Dynamo graph interop-excel.dyn (Dynamo 1.3.2.2480)

excel = Python()  # unwired: IN[0]
# ---------- excel.python (40 lines) ----------
import clr,System
clr.AddReference('Microsoft.Office.Interop.Excel')

import Microsoft.Office.Interop.Excel as Excel
from System.Runtime.InteropServices import Marshal
System.Threading.Thread.CurrentThread.CurrentCulture = System.Globalization.CultureInfo("en-US")

"""
# active excel doc
try:
	excel = Marshal.GetActiveObject("Excel.Application")
except:
	excel = "no active excel docs"
OUT = excel
"""


# excel app
excel = Excel.ApplicationClass()

excel.Visible = False
excel.DisplayAlerts = False
excel.ScreenUpdating = False

# open workbook
workbook = excel.Workbooks.Open(r"C:\Users\mrmin\OneDrive\Desktop\interop.xlsx")

author = workbook.Author
# collect sheets from workbook
sheets = workbook.Worksheets

# get sheet from sheets
sheet = sheets.Item("Sheet2")

# data 
range = sheet.UsedRange
columns = range.Columns.Count
rows = range.Rows.Count

OUT = columns,rows
# ----------------------------------------
