# Dynamo graph intersect.dyn (Dynamo 1.3.2.2480)

categories = Categories("Walls")
all_elements_of_category = ElementsOfCategory(categories)
geometry = Element.Geometry(all_elements_of_category)
flatten = Flatten(geometry)
categories_2 = Categories("PipeCurves")
all_elements_of_category_2 = ElementsOfCategory(categories_2)
geometry_2 = Element.Geometry(all_elements_of_category_2)
flatten_2 = Flatten(geometry_2)

# group: Place Dummy Family
family_types = FamilyTypes("Family1:Family1")
python_script = Python(IN[0]=flatten, IN[1]=flatten_2)  # frozen
# ---------- python_script.python (15 lines) ----------
import clr
clr.AddReference('ProtoGeometry')
from Autodesk.DesignScript.Geometry import *

walls = IN[0]
pipes = IN[1]
intersections = []

for wall in walls:
	for pipe in pipes:
		intersect = Geometry.Intersect(wall, pipe)
		if intersect:
			intersections.append(intersect)

OUT = intersections
# ----------------------------------------
flatten_3 = Flatten(python_script)
centroid = Solid.Centroid(flatten_3)
byPoint = FamilyInstance.ByPoint(familyType=family_types, point=centroid)

python_script_2 = Python(IN[0]=flatten, IN[1]=flatten_2)  # frozen
# ---------- python_script_2.python (16 lines) ----------
import clr
clr.AddReference('ProtoGeometry')
from Autodesk.DesignScript.Geometry import *

walls = IN[0]
pipes = IN[1]
intersections = []

for wall in walls:
	for pipe in pipes:
		intersect = Geometry.Intersect(wall, pipe)
		if intersect:
			intersections.append(intersect)
			

OUT = intersections
# ----------------------------------------
python_script_3 = Python(IN[0]=all_elements_of_category, IN[1]=all_elements_of_category_2)
# ---------- python_script_3.python (37 lines) ----------
import clr
clr.AddReference('ProtoGeometry')
clr.AddReference('RevitNodes')
clr.AddReference('RevitAPI')

import Revit
clr.ImportExtensions(Revit.Elements)
clr.ImportExtensions(Revit.GeometryConversion)

from Autodesk.DesignScript.Geometry import *
from Autodesk.Revit.DB import *

walls = UnwrapElement(IN[0])
pipes = UnwrapElement(IN[1])
intersections = []


def geo_con(e):
	# get geo-objects of the element
	geoelem = e.GetGeometryObjectFromReference(Reference(e))
	# get enumerator to loop geo-objects
	geoobj = geoelem.GetEnumerator()
	# loop geo-objector
	for obj in geoobj:
		# convert to dynamo type
		geo = obj.ToProtoType()
	# return geometry
	return geo


for wall in walls:
	intersections.append(geo_con(wall))


	

OUT = intersections
# ----------------------------------------
centerRoom = Python()  # frozen; unwired: IN[0]
# ---------- centerRoom.python (62 lines) ----------
# dynamo version - 1.3.2
# author - min.naung/mgjean https://twentytwo.space/contact/

import clr
clr.AddReference('ProtoGeometry')
clr.AddReference('RevitAPI')
clr.AddReference('RevitServices')
clr.AddReference("RevitNodes")

import System
import Revit
#clr.ImportExtensions(Revit.Elements)
clr.ImportExtensions(Revit.GeometryConversion)
from Autodesk.DesignScript.Geometry import (Geometry,
Point as pt)
from Autodesk.Revit.DB import *
from RevitServices.Persistence import DocumentManager
from RevitServices.Transactions import TransactionManager

doc = DocumentManager.Instance.CurrentDBDocument

elems = IN[0];

# make list
if not isinstance(elems,list):
	elems = UnwrapElement([elem])
else:
	elems = UnwrapElement(elems)

# output
res = []
# start transaction
TransactionManager.Instance.EnsureInTransaction(doc)

# loop elements
for e in elems:
	# level elevation - unit millimeter 
	elevation = e.Level.Elevation * 304.8
	# get geo-objects of the element
	geoelem = e.GetGeometryObjectFromReference(Reference(e))
	# get enumerator to loop geo-objects
	geoobj = geoelem.GetEnumerator()
	# loop geo-objector
	for obj in geoobj:
		# convert to dynamo type
		room_geometry = obj.ToProtoType()
		# get the centroid of the element
		point = room_geometry.Centroid()
		# create location point with level elevation
		center = pt.ByCoordinates(point.X,point.Y,elevation)
		# current element location
		current = e.Location.Point
		# point convert to revit and minus from current location
		newloc = center.ToXyz() - current
		# move to new location
		e.Location.Move(newloc)

# transaction done
TransactionManager.Instance.TransactionTaskDone()

# output
OUT = elems
# ----------------------------------------
