# Dynamo graph rebar.dyn (Dynamo 1.3.2.2480)

select_model_elements = DSModelElementsSelection()  # 2 picked in the model
# note: IN[0] = Description
# IN[0] = Setting (mm)
createRebarCoverType = Python()  # unwired: IN[0], IN[1]
# ---------- createRebarCoverType.python (24 lines) ----------
import clr

clr.AddReference('RevitAPI')
clr.AddReference("RevitServices")

from Autodesk.Revit.DB import *
from Autodesk.Revit.DB.Structure import *

from RevitServices.Persistence import DocumentManager
from RevitServices.Transactions import TransactionManager

doc = DocumentManager.Instance.CurrentDBDocument

cover_desc = IN[0] if IN[0] else "NewType"
cover_setting = IN[1]/304.8 if IN[1] else 25/304.8

TransactionManager.Instance.EnsureInTransaction(doc)

newtype = RebarCoverType.Create(doc,cover_desc, cover_setting)

TransactionManager.Instance.TransactionTaskDone()


OUT = newtype
# ----------------------------------------
# note: IN[0] = Framings
# IN[1] = RebarCoverType
setFramingRebarCoverType = Python(IN[0]=select_model_elements, IN[1]=createRebarCoverType)  # frozen
# ---------- setFramingRebarCoverType.python (33 lines) ----------
import clr

clr.AddReference('RevitAPI')
clr.AddReference("RevitServices")

from Autodesk.Revit.DB import *
from Autodesk.Revit.DB.Structure import *

from RevitServices.Persistence import DocumentManager
from RevitServices.Transactions import TransactionManager

doc = DocumentManager.Instance.CurrentDBDocument

framings = IN[0]
covertype = UnwrapElement(IN[1])
params = ["Rebar Cover - Top Face","Rebar Cover - Bottom Face",
"Rebar Cover - Other Faces"]

if isinstance(framings, list):
	framings = UnwrapElement(framings)
else:
	framings = UnwrapElement([framings])

TransactionManager.Instance.EnsureInTransaction(doc)

for framing in framings:
	for param in params:
		framing.LookupParameter(param).Set(covertype.Id)

TransactionManager.Instance.TransactionTaskDone()


OUT = framings
# ----------------------------------------
# note: IN[0] = Framings
getFramingRebarCoverType = Python(IN[0]=select_model_elements)
# ---------- getFramingRebarCoverType.python (35 lines) ----------
import clr

clr.AddReference('RevitAPI')
clr.AddReference("RevitServices")

from Autodesk.Revit.DB import *
from Autodesk.Revit.DB.Structure import *

from RevitServices.Persistence import DocumentManager
from RevitServices.Transactions import TransactionManager

doc = DocumentManager.Instance.CurrentDBDocument

framings = IN[0]

if isinstance(framings, list):
	framings = UnwrapElement(framings)
else:
	framings = UnwrapElement([framings])

top,btm, others = [],[],[]
#TransactionManager.Instance.EnsureInTransaction(doc)

for framing in framings:
	toptype = framing.LookupParameter("Rebar Cover - Top Face").AsElementId()
	top.append(doc.GetElement(toptype))
	btmtype = framing.LookupParameter("Rebar Cover - Bottom Face").AsElementId()
	btm.append(doc.GetElement(btmtype))
	otherstype = framing.LookupParameter("Rebar Cover - Other Faces").AsElementId()
	others.append(doc.GetElement(otherstype))

#TransactionManager.Instance.TransactionTaskDone()


OUT = top, btm, others
# ----------------------------------------
